# Grasshopper definition unnamed.gh (Grasshopper 0.9.76)
# plug-ins: Python Interpreter

pt = Point()
ps = PythonScript()  # -> out
# ---------- ps: Python ----------
from Rhino.Geometry import *
class Particle(object):
    def __init__(self,loc,vel = Vector3d.Zero,acc = Vector3d.Zero, mass = 1):
        self.loc = loc
        self.vel = vel
        self.acc = acc
        self.mass = mass
    def update(self):
        self.vel += self.acc
        self.loc += self.vel
    def applyForces(self,forces):
        if hasattr(forces,"__iter__"):
            for f in forces:
                self.applyForces(f)
        self.acc += forces / self.mass

class ParticleSystem():
    def __init__(self,particles = []):
        self.particles = particles
    def add(self,particles):
        if hasattr(particles,"__iter__"):
            for p in particle:
                self.add(p)
        self.particles.append(particles)
    def remove(self,particle):
        self.particles.remove(particle)
    def update(self):
        for p in self.particles:
            p.update()
    def applyForces(self,forces):
        for p in self:
            p.applyForces(forces)
    def __iter__(self):
        return self.particles
        
def setup(*args,**kwargs):
    locals().update(kwargs)
    print locals()
    gl = 'my global var'
    def decorator(func):
        var = 'game'
        clvar = 333
        def wrapped():
            return func()
        return wrapped
    return decorator

def global_var(*args,**kwargs):
    def deco(fn):
        def wrapped():
            locals().update(kwargs)
            return fn()
        return wrapped
    return deco

GLOBAL_DICT = {}
def echo(a):
    print a
def setup():
    a = 222
    b = 55
    f = 666
    return(locals())
setup()

@global_var(a = 933,b='what')
def draw():
    for k,v in setup().items():
        print k,v
        exec('%s = %r'%(k,v))
    print "LOOK HERE!!!",b
    print locals()
    print 'draw test'

draw()
print 'free:',draw.__code__.co_freevars
print 'cell:',draw.__code__.co_cellvars
print draw.__closure__
for clo in draw.__closure__:
    print clo.cell_contents,1

def clear():
    for uniquevar in [var for var in globals().copy() if var[0] != "_"]:
        del globals()[uniquevar]
# ---------- end ps ----------
swatch = ColourSwatch(SwatchColor=RGB(87, 86, 52))
python = PythonScript()  # -> out, a
# ---------- python: Python ----------
from pgh.core import *
class Spring2D(object):
        def __init__(self, xpos, ypos, m, g):
            # The x- and y-axis velocities
            self.vx = 0
            self.vy = 0
            # The x- and y-coordinates
            self.x = xpos
            self.y = ypos
            self.radius = 15
            self.stiffness = 0.2
            self.damping = 0.7
            self.mass = m
            self.gravity = g
    
        def update(self, targetX, targetY):
            forceX = (targetX - self.x) * self.stiffness
            ax = forceX / self.mass
            self.vx = self.damping * (self.vx + ax)
            self.x += self.vx
            forceY = (targetY - self.y) * self.stiffness
            forceY += self.gravity
            ay = forceY / self.mass
            self.vy = self.damping * (self.vy + ay)
            self.y += self.vy
    
        def display(self, nx, ny):
            noStroke()
            ellipse(self.x, self.y, self.radius * 2, self.radius * 2)
            stroke(255,0,0)
            line(self.x, self.y, nx, ny)
a = Spring2D
# ---------- end python ----------
toggle = BooleanToggle(False)
timer = Timer(TimerInterval=10, Target=pgh)  # disabled
timer_2 = Timer(TimerInterval=10, Target=pgh_2)  # disabled
timer_3 = Timer(TimerInterval=20, Target=[pgh_5, pgh_3])  # disabled
button = Button()
pgh = Processing(RESET=Button(), CLASS=flatten(python.a), x=swatch)  # -> out, GeoOut, ColorOut, port; inputs RESET: Boolean, CLASS: list; disabled
# ---------- pgh: Python ----------
import pgh
from pgh.core import *
reload(pgh)

def setup():
    background(180,180,180)
    size(800, 800)
    global springs,gravity
    gravity = 18.0
    springs = [Spring2D(0, 0, i+1, gravity) for i in range(10)]
print ghenv.LocalScope.setup == globals()['setup']
@loop
def draw():
    global CPLANE
    background(180,180,180)
    screen = rs.GetCursorPos()[3]
    ln =sc.doc.Views.ActiveView.ActiveViewport.ClientToWorld(screen)
    intsect = Intersect.Intersection.LinePlane(ln,CPLANE)[1]
    p = ln.PointAt(intsect)
    print p
    s = Sphere(p,5)
    GeoOut.Add(s)
    #CPLANE = sc.doc.Views.ActiveView.ActiveViewport.PushConstructionPlane(cp)
    print color(255,100,100)
    stroke(255,100,100)
    strokeWeight(10)
    line(0,50,100,50)
    print 'frist arc',style.STROKE_WEIGHT
    pushStyle()
    stroke(100,255,100)
    strokeWeight(5)
    line(0,20,100,20)
    popStyle()
    stroke(100,100,255)
    strokeWeight(1)
    line(0,0,100,0)
    print 'second arc',style.STROKE_WEIGHT
    _x,_y = mouseX, mouseY
    for s in springs:
        s.update(_x,_y)
        s.display(_x,_y)
        _x,_y = s.x, s.y
    text('processing!',100,100)
if RESET:
    setting(ghenv)
    setup()
else:
    draw()
print CPLANE
print sc.doc.Views.ActiveView.ActiveViewport.GetFrustumNearPlane()[1]
print sc.doc.Views.ActiveView.ActiveViewport.GetCameraFrame()[1]
print ghenv.Component.Params.Output[2].Access
# ---------- end pgh ----------
pgh_2 = Processing(RESET=Toggle(True), CLASS=flatten(python.a), x=swatch)  # -> out, GeoOut, ColorOut, port; inputs RESET: Boolean, CLASS: list
# ---------- pgh_2: Python ----------
import pgh
from pgh.core import *

def setup():
    reload(pgh)
    background(180,180,180)
    size(800, 800)
    global springs,gravity
    gravity = 18.0
    springs = [Spring2D(0, 0, i+1, gravity) for i in range(10)]
def draw():
    global CPLANE
    background(180,180,180)
    screen = rs.GetCursorPos()[3]
    ln =sc.doc.Views.ActiveView.ActiveViewport.ClientToWorld(screen)
    intsect = Intersect.Intersection.LinePlane(ln,CPLANE)[1]
    p = ln.PointAt(intsect)
    print p
    s = Sphere(p,5)
    GeoOut.Add(s)
    #CPLANE = sc.doc.Views.ActiveView.ActiveViewport.PushConstructionPlane(cp)
    print color(255,100,100)
    stroke(255,100,100)
    strokeWeight(10)
    line(0,50,100,50)
    print 'frist arc',style.STROKE_WEIGHT
    pushStyle()
    stroke(100,255,100)
    strokeWeight(5)
    line(0,20,100,20)
    popStyle()
    stroke(100,100,255)
    strokeWeight(1)
    line(0,0,100,0)
    print 'second arc',style.STROKE_WEIGHT
    _x,_y = mouseX, mouseY
    for s in springs:
        s.update(_x,_y)
        s.display(_x,_y)
        _x,_y = s.x, s.y
    text('processing!',100,100)

GO(ghenv)
print ghenv.Component.Params.Output[2].Access
# ---------- end pgh_2 ----------
pgh_3 = Processing(RESET=Toggle(True))  # -> out, GeoOut, ColorOut; inputs RESET: Boolean, CLASS: list; disabled
# ---------- pgh_3: Python ----------
import pgh
reload(pgh)
from pgh.core import *
#########custom code below###########
def setup():
    fill(255)
    print CPLANESTACK
    pushMatrix()
    ellipse(0,0,30,30)
    translate(30,30)
    print CPLANESTACK
    ellipse(0,0,30,30)
    popMatrix()
    ellipse(0,0,-30,-30)
    print CPLANESTACK
    print CPLANE


def draw():
    print LOOP_COUNT
    print style.FILL_COLOR
    
#########custom code above###########
GO(ghenv)
print mousePressed
# ---------- end pgh_3 ----------
pgh_4 = Processing(RESET=Toggle(True))  # -> out, GeoOut, ColorOut; inputs RESET: Boolean, CLASS: list
# ---------- pgh_4: Python ----------
import pgh
reload(pgh)
from pgh.core import *
#########custom code below###########
def setup():
    fill(255)
    print CPLANES
    pushMatrix()
    ellipse(0,0,30,30)
    translate(30,30)
    print CPLANES
    ellipse(0,0,30,30)
    popMatrix()
    ellipse(0,0,-30,-30)
    print CPLANES


def draw():
    print LOOP_COUNT
    print style.FILL_COLOR
    
#########custom code above###########
GO(ghenv)
print mousePressed
# ---------- end pgh_4 ----------
pgh_5 = Processing(RESET=True)  # -> out, GeoOut, ColorOut; inputs RESET: Boolean, CLASS: list; disabled
# ---------- pgh_5: Python ----------
import pgh
reload(pgh)
from pgh.core import *
#########custom code below###########
def setup():
    fill(255,0,128)
    print CPLANESTACK
    pushMatrix()
    ellipse(0,0,10,10)
    translate(30,30)
    print CPLANESTACK
    ellipse(0,0,10,10)
    popMatrix()
    ellipse(0,0,-10,-10)
    print CPLANESTACK
    print CPLANE


def draw():
    print LOOP_COUNT
    print style.FILL_COLOR
    
#########custom code above###########
GO(ghenv)
print mousePressed
# ---------- end pgh_5 ----------
preview = CustomPreview(Geometry=pgh_3.GeoOut, Shader=pgh_3.ColorOut)
preview_2 = CustomPreview(Geometry=pgh_5.GeoOut, Shader=pgh_5.ColorOut)
panel = Panel(pgh_3.GeoOut)
panel_2 = Panel(pgh.ColorOut)
